# Dynamo graph ditch_03_build_long.dyn "dump_assembly" (Dynamo 2.18.1.5096)

python_script = Python()  # CPython3
# ---------- python_script.python (43 lines) ----------
import clr, importlib, os, sys

clr.AddReference("AecBaseMgd")
clr.AddReference("AeccDbMgd")
clr.AddReference("acmgd")
clr.AddReference("acdbmgd")

try:
    _LIB_ROOT = os.path.dirname(
        os.path.dirname(os.path.dirname(os.path.abspath(__file__)))
    )
except NameError:
    _LIB_ROOT = os.environ.get("ARHYZ_LIB_ROOT", r"C:\Arhyz\automation\scripts\ditch")

_AUTOMATION_ROOT = os.path.dirname(_LIB_ROOT)

if _LIB_ROOT not in sys.path:
    sys.path.insert(0, _LIB_ROOT)
if _AUTOMATION_ROOT not in sys.path:
    sys.path.insert(0, _AUTOMATION_ROOT)

# Drop this package from sys.modules so the next import reloads every submodule
# fresh in dependency order (see ditch_04_build_cross/launcher.py for why).
for _name in [
    m
    for m in list(sys.modules)
    if m.startswith("ditch_03_build_long") or m.startswith("ditch_core")
]:
    del sys.modules[_name]
for _name in sorted(
    [m for m in sys.modules if m.startswith("civil")],
    reverse=True,
):
    try:
        importlib.reload(sys.modules[_name])
    except Exception:
        pass

from ditch_03_build_long.builder import LongitudinalDitchBuilder

# Main script: drape every 2D longitudinal-ditch polyline on inf_ct_toe onto the
# trasse surface (−0.55 m) and replace it with the 3D polyline. No selection needed.
OUT = LongitudinalDitchBuilder().run()
# ----------------------------------------
