# Dynamo graph help_clear_inf.dyn "clear_inf" (Dynamo 2.18.1.5096)

python_script = Python()  # CPython3
# ---------- python_script.python (26 lines) ----------
import clr, importlib, os, sys

clr.AddReference("acmgd")
clr.AddReference("acdbmgd")

try:
    _LIB_ROOT = os.path.dirname(os.path.dirname(os.path.abspath(__file__)))
except NameError:
    _LIB_ROOT = os.environ.get("ARHYZ_LIB_ROOT", r"C:\Arhyz\automation\scripts")
_AUTOMATION_ROOT = os.path.dirname(_LIB_ROOT)
if _LIB_ROOT not in sys.path:
    sys.path.insert(0, _LIB_ROOT)
if _AUTOMATION_ROOT not in sys.path:
    sys.path.insert(0, _AUTOMATION_ROOT)

for _name in sorted(
    [m for m in sys.modules if m.startswith("help_clear_inf")], reverse=True
):
    try:
        importlib.reload(sys.modules[_name])
    except Exception:
        pass

from help_clear_inf.builder import ClearInfBuilder

OUT = ClearInfBuilder(IN[0] if IN and IN[0] else "inf").run()
# ----------------------------------------
