# Dynamo graph anchor_01_build_surfaces.dyn (Dynamo 2.18.1.5096)

select_object = ObjectSelection()  # 1 picked in the model
select_object_2 = ObjectSelection()  # 1 picked in the model
python_script = Python(IN[0]=select_object, IN[1]=select_object_2)  # CPython3
# ---------- python_script.python (45 lines) ----------
import clr, os, sys

clr.AddReference("AecBaseMgd")
clr.AddReference("AeccDbMgd")
clr.AddReference("acmgd")
clr.AddReference("acdbmgd")

try:
    _REPO_ROOT = os.path.dirname(os.path.abspath(__file__))
    while (
        not os.path.isdir(os.path.join(_REPO_ROOT, "common"))
        and os.path.dirname(_REPO_ROOT) != _REPO_ROOT
    ):
        _REPO_ROOT = os.path.dirname(_REPO_ROOT)
except NameError:
    # Inside the Dynamo .dyn node __file__ is undefined -> ONE shared project anchor;
    # every root below is derived relative to it, identical for every nk_toolkit script.
    _REPO_ROOT = os.environ.get("NK_TOOLKIT_ROOT", r"C:\nk_toolkit")

_ROOT = os.path.join(_REPO_ROOT, "scripts")
_COMMON = os.path.join(_REPO_ROOT, "common")
_ANCHOR = os.path.join(_ROOT, "anchor")
for _p in (_ANCHOR, _ROOT, _COMMON):
    if _p in sys.path:
        sys.path.remove(_p)
    sys.path.insert(0, _p)
# both toolkits have a top-level paths.py: never reuse the copy cached by the OTHER toolkit's
# scripts earlier in this Dynamo session (own dirs are moved to the front just above)
sys.modules.pop("paths", None)
# Drop this package so the next import reloads every submodule fresh in
# dependency order (see ditch_04_build_cross/launcher.py for the rationale).
for _name in [m for m in list(sys.modules) if m.startswith("anchor_")]:
    del sys.modules[_name]
for _name in sorted(
    [m for m in sys.modules if m.startswith("civil")],
    reverse=True,
):
    del sys.modules[_name]
from anchor_01_build_surfaces.builder import AnchorSurfaceBuilder

# IN[0] / IN[1] come from the two "Select Object" nodes (surface + boundary
# polyline, in either order). Build one flat surface per CSV elevation. Returns
# the log file path.
_inputs = list(globals().get("IN", []))
OUT = AnchorSurfaceBuilder().run(_inputs)
# ----------------------------------------
