# Dynamo graph build_corridors.dyn (Dynamo 2.18.1.5096)

string = StringInput("НК-2D-1")  # graph input
python_script = Python(IN[0]=string)  # CPython3
# ---------- python_script.python (28 lines) ----------
import clr, importlib, os, sys

clr.AddReference("AecBaseMgd")
clr.AddReference("AeccDbMgd")
clr.AddReference("acmgd")
clr.AddReference("acdbmgd")

try:
    _LIB_ROOT = os.path.dirname(os.path.dirname(os.path.abspath(__file__)))
except NameError:
    _LIB_ROOT = os.environ.get("ARHYZ_LIB_ROOT", r"C:\Arhyz\automation\scripts")
_AUTOMATION_ROOT = os.path.dirname(_LIB_ROOT)
if _LIB_ROOT not in sys.path:
    sys.path.insert(0, _LIB_ROOT)
if _AUTOMATION_ROOT not in sys.path:
    sys.path.insert(0, _AUTOMATION_ROOT)

for _name in sorted(
    [m for m in sys.modules if m.startswith("build_corridors")], reverse=True
):
    try:
        importlib.reload(sys.modules[_name])
    except Exception:
        pass

from build_corridors.corridor_builder import CorridorBuilder

OUT = CorridorBuilder(IN[0]).run()
# ----------------------------------------
