# Dynamo graph draw_gabion_view.dyn (Dynamo 2.18.1.5096)

string = StringInput("НК-1А-5")  # graph input
python_script = Python(IN[0]=string)  # CPython3
# ---------- python_script.python (46 lines) ----------
import clr, os, sys

clr.AddReference("AecBaseMgd")
clr.AddReference("AeccDbMgd")
clr.AddReference("acmgd")
clr.AddReference("acdbmgd")

try:
    _REPO_ROOT = os.path.dirname(os.path.abspath(__file__))
    while (
        not os.path.isdir(os.path.join(_REPO_ROOT, "common"))
        and os.path.dirname(_REPO_ROOT) != _REPO_ROOT
    ):
        _REPO_ROOT = os.path.dirname(_REPO_ROOT)
except NameError:
    # Inside the Dynamo .dyn node __file__ is undefined -> ONE shared project anchor;
    # every root below is derived relative to it, identical for every nk_toolkit script.
    _REPO_ROOT = os.environ.get("NK_TOOLKIT_ROOT", r"C:\nk_toolkit")

_ROOT = os.path.join(_REPO_ROOT, "scripts")
_COMMON = os.path.join(_REPO_ROOT, "common")
for _p in (_ROOT, _COMMON):
    if _p in sys.path:
        sys.path.remove(_p)
    sys.path.insert(0, _p)
# both toolkits have a top-level paths.py: never reuse the copy cached by the OTHER toolkit's
# scripts earlier in this Dynamo session (own dirs are moved to the front just above)
sys.modules.pop("paths", None)
# Purge cached package modules instead of importlib.reload: reload() re-imports a
# module's dependencies from sys.modules in whatever order the reload loop runs, so
# builder could bind a stale BlockManager before blocks reloaded. Deleting the
# entries forces the import below to rebuild the whole tree in dependency order.
for _name in [
    m
    for m in list(sys.modules)
    if m == "draw_gabion_view"
    or m.startswith("draw_gabion_view.")
    or m == "civil"
    or m.startswith("civil.")
    or m == "paths"
]:
    del sys.modules[_name]

from draw_gabion_view.builder import GabionViewBuilder

OUT = GabionViewBuilder(IN[0]).run()
# ----------------------------------------
